# Grasshopper definition S2-intro-to-graphs.gh (Grasshopper 1.0.8)

list = ValueList({"graphs-01-intro": 0, "graphs-02-graph-from-mesh": 1, "graphs-03-with-data": 2, "graphs-04-dual-graph": 3, "graphs-05-shorest-paths": 4}, selected="graphs-01-intro")
graphs_02_graph_from_mesh = FilePath("C:\Users\Lenovo\Desktop\Session 2\session02\graphs\graphs-02-graph-from-mesh.py")
graphs_05_shorest_paths = FilePath("C:\Users\Lenovo\Desktop\Session 2\session02\graphs\graphs-05-shorest-paths.py")
graphs_04_dual_graph = FilePath("C:\Users\Lenovo\Desktop\Session 2\session02\graphs\graphs-04-dual-graph.py")
graphs_03_with_data = FilePath("C:\Users\Lenovo\Desktop\Session 2\session02\graphs\graphs-03-with-data.py")
graphs_01_intro = FilePath("C:\Users\Lenovo\Desktop\Session 2\session02\graphs\graphs-01-intro.py")
number_slider = Slider(6, range=0..10)
filter = StreamFilter(
    Gate=list,
    Stream0=graphs_01_intro,
    Stream1=graphs_02_graph_from_mesh,
    Stream2=graphs_03_with_data,
    Stream3=graphs_04_dual_graph,
    Stream4=graphs_05_shorest_paths)
mplane = MeshPlane(
    Boundary={Plane=PlaneXY(0, 0, 0), Size=Domain2(u=-10..10, v=-10..10)},
    WidthCount=number_slider,
    HeightCount=number_slider)  # -> Mesh, Area
quadmesh = Mesh(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)
trimesh = Mesh(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)
panel = Panel(filter)
file = ReadFile(File=filter, PerLineParse=False)
py3 = Python3Script(script=file, m=mplane.Mesh)  # -> out, a, b, c; inputs m: Mesh; unedited script template
